# Grasshopper definition GHToDynamo.gh (Grasshopper 0.9.76)
# plug-ins: Python Interpreter

panel = Panel("""C:\Users\Mostapha\AppData\Roaming\Dynamo\Dynamo Revit\1.2\packages\Butterfly\extra\nodesrc
C:\Users\Mostapha\Documents\code\ladybug-tools\butterfly-plus\plugin\dynamo\src""")
panel_2 = Panel("""C:\Users\Mostapha\AppData\Roaming\Dynamo\Dynamo Revit\1.2\packages\Butterfly\dyf
C:\Users\Mostapha\Documents\code\ladybug-tools\butterfly-plus\plugin\dynamo\definitions""")
number_slider = Slider(1, range=0..1)
# controlDict default value for empty list for functions doesn't work. Should be changed to null.
path = FilePath(panel)
path_2 = FilePath(panel_2)
item = ListItem(List=path_2, Index=number_slider, Wrap=True)
panel_3 = Panel("*")
item_2 = ListItem(List=path, Index=number_slider, Wrap=True)

panel_4 = Panel("C:\Users\Mostapha\Documents\code\ladybug-tools\butterfly-plus\plugin\grasshopper\userObjects")
updateladybug = Ladybug_UpdateLadybug(sourceDirectory=panel_4, updateThisFile=Toggle(False))  # -> readMe; plug-in component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

components = PythonScript(nodePath=item, sourcePath=item_2, export=Toggle(False))  # -> readMe; inputs components: list, export: Boolean
# ---------- components: Python ----------
"""
Export Ladybug Analysis Tools Python Components to Dynamo

    Args:
        _components: Any output from a new Ladybug (or Honeybee) component that you wish to export. Right now, only one component can be connected at a time but you can input a "*" (without quotation marsk) to search all changed Ladybug components on a grasshopper canvas.
        _path: A file path on your system which you would like to export the user object and source code to.  For most code developers, this file path will lead to their Github folder for Ladybug (or Honeybee), which is usually installed in "My Documents" by default. Exported source code will be saved at .\src and exported userObjects will be saved at .\userObjects in this _targetFolder.
        _export: Set to "True" to export Ladybug (or Honeybee) components to the _targerFolder.
    Returns:
        readMe!: ...
"""

def getAllTheComponents(onlyGHPython = True):
    components = []
    
    document = ghenv.Component.OnPingDocument()
    
    for component in document.Objects:
        if onlyGHPython and type(component)!= type(ghenv.Component):
            pass
        else:
            components.append(component)
    
    return components

def getListOfConnectedComponents(componentInputParamIndex = 0, onlyGHPython = True):

    components = []
    
    param = ghenv.Component.Params.Input[componentInputParamIndex]
    sources = param.Sources
    
    if sources.Count == 0:
        return components
    
    for source in sources:
        attr = source.Attributes
        if (attr is None) or (attr.GetTopLevel is None):
            component = None
        else:
            component = attr.GetTopLevel.DocObject
        
        if component == None or (onlyGHPython and type(component) != type(ghenv.Component)):
                #collect only python components
                pass
        else:
            components.append(component)
    
    return components


def mapGHCodeToDS(inputs, outputs, code):
    mapping = {'grasshopper': 'dynamo', 'Grasshopper': 'Dynamo', 'GH': 'DS',
        'Food4Rhino': 'Package Manager'}

    code = code.split('\n')
    
    for count, line in enumerate(code):
        if line.startswith('ghenv.Component.AdditionalHelpFromDocStrings'):
            break
    
    gist = '\n'.join(code[count + 1:])           
    
    for o, t in mapping.iteritems():
        gist = gist.replace(o, t)
    
    # add inputs to the top of the code
    if len(inputs) == 0:
        header = ''
    elif len(inputs) == 1:
        header = '%s = IN[0]' % inputs[0].name
    else:
        header = '%s = IN' % ', '.join(inp.name for inp in inputs)
        
    # define outputs as None to avoid crashing on return
    header_1 = '%s = None' % ' = '.join(out.name for out in outputs)
    # add outputs to the end of the code
    if len(outputs) == 1:
        footer = 'OUT = (%s,)' % outputs[0].name
    else:
        footer = 'OUT = %s' % ', '.join(out.name for out in outputs)
    
    dcode = '\n'.join(('# assign inputs', header, header_1, gist, '\n# assign outputs to OUT', footer))
    return dcode

import grasshopper_component
reload(grasshopper_component)
from grasshopper_component import Component
import dynamo_custom_node
reload(dynamo_custom_node)
from dynamo_custom_node import nodeFromComponent
import os.path as path

plugins = ('Ladybug', 'Honeybee', 'Butterfly')
if _export and _components and _nodePath and _sourcePath:
    
    if str(_components[0]) == "*":
        ghComps = getAllTheComponents()
    else:
        ghComps = getListOfConnectedComponents()
    
    for ghComp in ghComps:
        if ghComp.Name.split('_')[0] in plugins:
            component = Component.fromGHComponent(ghComp)

            if component.name == 'Butterfly_Create Butterfly Geometry' or \
                component.name == 'Butterfly_Refinement Region':
                # find mesh setting input
                inp = [i for i in component.inputs if i.name == '_meshSet_'][0]
                inp.accessType = 'list'
                inp.valueType = 'int'
                inp.description = 'Dynamo mesh settings as a list (tolerance, maxGridLines). Default (-1, 512).'
                inp.defaultValue = [-1, 512]
            
            nodeFromComponent(component, _nodePath)
            # write source code
            src = mapGHCodeToDS(component.inputs, component.outputs, ghComp.Code)
            srcfp = '%s' % path.join(_sourcePath.replace('\\', '\\\\'), '%s_node.py' % ghComp.NickName.lower())
            with open(srcfp, 'wb') as outf:
                 outf.write(src)
# ---------- end components ----------
panel_5 = Panel("C:\Users\Mostapha\Documents\code\ladybug-tools\butterfly-plus\plugin\grasshopper")
panel_6 = Panel(components)

# ---- group: don't delete this component
plotresiduals = Butterfly_PlotResiduals()  # -> readMe, timeRange, fields, values; disabled; plug-in component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

# ----
exportladybug = Ladybug_ExportLadybug(targetFolder=panel_5, export=Toggle(False))  # -> readMe; plug-in component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
